# Grasshopper definition 260308_Lamp Design For three js.gh (Grasshopper 1.0.8)
# plug-ins: jSwan, Pufferfish, Warp

# ---- group: pendant Lamp
control_the_position_of_body_expansion_a = Slider(6.39, range=1.05..10)  # "Control the position of body expansion and contraction"
control_the_expansion_and_contraction_of = Slider(1.07, range=0.25..3)  # "Control the expansion and contraction of the form"
light_x_size_width = Slider(0.32, range=0.03..2)
smoothness = Slider(0.52, range=0.01..1)
expected_top_surface_of_the_lamp = Slider(0.44, range=0.03..3)
light_y_size_length = Slider(0.42, range=0.03..2)
lamp_height = Slider(0.67, range=0.03..2)

# ----
thickness = Slider(0.064, range=0.002..1)

# ---- group: Color
red = Slider(52, range=0..255)
alpha = Slider(78, range=0..255)
green = Slider(103, range=0..255)
blue = Slider(86, range=0..255)

# ----
colour_rgb = ColourRGB(Alpha=alpha, Red=red, Green=green, Blue=blue)
warp_receiver = WarpReceiver(Toggle=Toggle(True), RoomKey="linyun")  # -> Session, Connected, LatestParamsJson, Status
panel = Panel(warp_receiver.LatestParamsJson)
deserialize_json = DeserializeJson(JSON=warp_receiver.LatestParamsJson, OutputsLocked=False)
deserialize_keys_and_values = DeserializeKeysAndValues(JSON=deserialize_json, Keys="Value")  # -> Key, Value
explode_tree = ExplodeTree(Data=deserialize_keys_and_values.Value)  # -> Branch0, Branch1, Branch2, Branch3, Branch4, Branch5, Branch6, Branch7
bounds = Bounds(Numbers=[explode_tree.Branch1, explode_tree.Branch2])
deconstruct_domain = DeconstructDomain(Domain=bounds)  # -> Start, End
division = Division(A=deconstruct_domain.Start, B=2)
construct_domain = ConstructDomain(DomainStart=0, DomainEnd=division)
panel_2 = Panel(explode_tree.Branch6)
panel_3 = Panel(explode_tree.Branch0)
remap_numbers = RemapNumbers(Value=explode_tree.Branch3, Source=Domain(0, 1), Target=construct_domain)  # -> Mapped, Clipped
division_2 = Division(A=panel_3, B=panel_2)
rectangle = Rectangle(Plane="{0,0,2}", XSize=explode_tree.Branch1, YSize=explode_tree.Branch2, Radius=remap_numbers.Mapped)  # -> Rectangle, Length
unit_z = UnitZ(Factor=explode_tree.Branch0)
curve = Curve(rectangle.Rectangle)
unit_z_2 = UnitZ(Factor=division_2)
move = Move(Geometry=curve, Motion=unit_z)  # -> Geometry, Transform
curve_2 = Curve(rectangle.Rectangle)
move_2 = Move(Geometry=curve_2, Motion=unit_z_2)  # -> Geometry, Transform
area = Area(Geometry=move.Geometry)  # -> Area, Centroid
area_2 = Area(Geometry=move_2.Geometry)  # -> Area, Centroid
scale = Scale(Geometry=move.Geometry, Center=area.Centroid, Factor=explode_tree.Branch4)  # -> Geometry, Transform
scale_2 = Scale(Geometry=move_2.Geometry, Center=area_2.Centroid, Factor=explode_tree.Branch5)  # -> Geometry, Transform
merge = Merge(Data1=curve, Data2=scale_2.Geometry, Data3=scale.Geometry)
area_3 = Area(Geometry=merge)  # -> Area, Centroid
sort_list = SortList(Keys=area_3.Area, ValuesValuesA=merge)  # -> Keys, ValuesValuesA
list_item = ListItem(List=sort_list.ValuesValuesA, Index=0, Wrap=True)
area_4 = Area(Geometry=sort_list.ValuesValuesA)  # -> Area, Centroid
deconstruct_brep = DeconstructBrep(Brep=list_item)  # -> Faces, Edges, Vertices
curve_middle = CurveMiddle(Curve=deconstruct_brep.Edges)
distance = Distance(PointA=area_4.Centroid, PointB=curve_middle)
sort_list_2 = SortList(Keys=distance, ValuesValuesA=distance)  # -> Keys, ValuesValuesA
list_item_2 = ListItem(List=sort_list_2.ValuesValuesA, Index=0, Wrap=True)
division_3 = Division(A=list_item_2, B=2)
construct_domain_2 = ConstructDomain(DomainStart=0, DomainEnd=division_3)
loft = Loft(Curves=merge, Options={Adjust=False, Closed=False, LoftEnds=0, LoftSimp=0, LoftType=0, Rebuild=10, Refit=0.01})
remap_numbers_2 = RemapNumbers(Value=Slider(-1, range=-1..0), Source=Domain(0, 1), Target=construct_domain_2)  # -> Mapped, Clipped
deconstruct_brep_2 = DeconstructBrep(Brep=loft)  # -> Faces, Edges, Vertices
closed = Closed(Curve=deconstruct_brep_2.Edges)  # -> Closed, Periodic
dispatch = Dispatch(List=deconstruct_brep_2.Edges, DispatchPattern=closed.Closed)  # -> ListA, ListB
area_5 = Area(Geometry=dispatch.ListA)  # -> Area, Centroid
deconstruct = Deconstruct(Point=area_5.Centroid)  # -> XComponent, YComponent, ZComponent
sort_list_3 = SortList(Keys=deconstruct.ZComponent, ValuesValuesA=dispatch.ListA)  # -> Keys, ValuesValuesA
number = Number(explode_tree.Branch7)
list_item_3 = ListItem(List=reverse(sort_list_3.ValuesValuesA), Index=0, Wrap=True)
negative = Negative(Value=number)
boundary_surfaces = BoundarySurfaces(Edges=list_item_3)
offset_surface = OffsetSurface(Surface=loft, Distance=negative, Retrim=True)
area_6 = Area(Geometry=boundary_surfaces)  # -> Area, Centroid
merge_2 = Merge(Data1=boundary_surfaces, Data2=loft)
line_sdl = LineSDL(Start=area_6.Centroid, Direction=Vector(0, 0, 1), Length=1.25)
number_2 = Number(explode_tree.Branch1)
division_4 = Division(A=number_2, B=50)
offset_surface_2 = OffsetSurface(Surface=merge_2, Distance=negative, BothSides=0, CreateSolid=True)
pipe = Pipe(Curve=line_sdl, Radius=division_4, Caps=0)
custom_preview = CustomPreview(Geometry=offset_surface_2, Material=colour_rgb)
geometry = Geometry([offset_surface_2, pipe])
mesh_colours = MeshColours(Mesh=geometry, Colours=colour_rgb)
panel_4 = Panel(explode_tree.Branch6)
mesh_join = MeshJoin(Meshes=flatten(mesh_colours))
warp_sender = WarpSender(Session=warp_receiver.Session, Enabled=warp_receiver.Connected, ForceSend=False, Meshes=mesh_join)  # -> Status, LastHash
panel_5 = Panel(deserialize_keys_and_values.Value)
panel_6 = Panel(warp_sender.LastHash)
